# Grasshopper definition 3drepotest.gh (Grasshopper 1.0.7)
# plug-ins: BH.UI.Grasshopper

line = Line([Line((0, 0, 0), (0, 0, 3)), Line((0, 5, 0), (0, 5, 3)), Line((0, 10, 0), (0, 10, 3)), Line((0, 15, 0), (0, 15, 3)), Line((0, 20, 0), (0, 20, 3)), Line((5, 20, 0), (5, 20, 3)), Line((10, 20, 0), (10, 20, 3)), Line((10, 15, 0), (10, 15, 3)), Line((10, 10, 0), (10, 10, 3)), Line((10, 5, 0), (10, 5, 3)), Line((10, 0, 0), (10, 0, 3)), Line((5, 0, 0), (5, 0, 3))])
len = Length(Curve=line)
levels = Slider(3, range=0..10)
item = ListItem(List=len, Index=0, Wrap=True)
series = Series(Start=0, Step=item, Count=expr("x+1", levels))
uc = UC(
    {"UC 356x406x1299": 0, "UC 356x406x1202": 1, "UC 356x406x1086": 2, "UC 356x406x990": 3, "UC 356x406x900": 4, "UC 356x406x818": 5, "UC 356x406x744": 6, "UC 356x406x677": 7, "UC 356x406x634": 8, "UC 356x406x592": 9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}, selected="UC 203x203x113": 34,
    Component="{ \"_t\": \"System.String\", \"_v\": \"SectionProperties\\\\UK_SteelSections\\\\UC\"}",
    Selection=34)
Z = UnitZ(Factor=series)
end = EndPoints(Curve=line)  # -> Start, End
Z_2 = UnitZ(Factor=Slider(0.4, range=0..1))
bar = Bar(
    Line=line,
    Property=uc,
    OrientationAngle=0,
    FeaType="{ \"_t\" : \"System.Enum\", \"TypeName\" : { \"_t\" : \"System.Type\", \"Name\" : \"BH.oM.Structure.Elements.BarFEAType\" }, \"Value\" : \"Flexural\" }",
    Component="{ .Bar")
move = Move(Geometry=end.End, Motion=Z_2)  # -> Geometry, Transform
bbox = BoundingBox(Content=[end.End, move.Geometry], Plane=PlaneXY(0, 0, 0), UnionBox=True)  # -> Box, Box_2
smesh = SimpleMesh(Brep=bbox.Box)
extrude = Extrude(Bar=bar, Simple=True, Component="{ .Extrude")  # -> flatten(I)
data = Data([smesh, extrude])
move_2 = Move(Geometry=data, Motion=graft(Z))  # -> Geometry, Transform
mbox = MeshBox(Base={Plane=PlaneXY(0, 0, 0), X=Domain(-10, 10), Y=Domain(-10, 10), Z=Domain(-10, 10)}, XCount=10, YCount=10, ZCount=10)
repoadapter = RepoAdapter(
    Teamspace="alexlomba87",
    ModelId="d90b500e-788a-4c63-9117-f567243714f5",
    ApiKey="dcff44ef043bdd0639c86d013069172d",
    Url="https://api1.www.3drepo.io/api",
    Component="{ ..ctor")
tobhom = ToBHoM(RMesh=mbox)
push = Push(Adapter=repoadapter, Objects=flatten(move_2.Geometry), Active=Toggle(True), Component="{ .Push")  # -> Objects, Success
