# Grasshopper definition aecMobilityDemo.gh (Grasshopper 1.0.7)
# plug-ins: UserDataUtils, BH.UI.Grasshopper

# ----
# Set up 3D Repo Adapter
panel = Panel("d90b500e-788a-4c63-9117-f567243714f5")
repoadapter = RepoAdapter(
    Teamspace="alexlomba87",
    ModelId=panel,
    ApiKey="dcff44ef043bdd0639c86d013069172d",
    Url="https://api1.www.3drepo.io/api",
    Component="{ ..ctor")

# ----
# Set up Speckle Adapter
anonymous_stream = DataSender(manualmode=False, remotecontroller=False)  # -> Log, StreamId
speckle_hestia = Accounts()
speckleadapter = SpeckleAdapter(SpeckleAccount=speckle_hestia, SpeckleStreamId=anonymous_stream.StreamId, Component="{ ..ctor")

# ----
# Generate Multistorey Building
# Set Column size
# (section property)
# Set no. of Levels
levels = Slider(3, range=1..7)
uc = UC(
    {"UC 356x406x1299": 0, "UC 356x406x1202": 1, "UC 356x406x1086": 2, "UC 356x406x990": 3, "UC 356x406x900": 4, "UC 356x406x818": 5, "UC 356x406x744": 6, "UC 356x406x677": 7, "UC 356x406x634": 8, "UC 356x406x592": 9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}, selected="UC 356x406x1299",
    Component="{ \"_t\": \"System.String\", \"_v\": \"SectionProperties\\\\UK_SteelSections\\\\UC\"}",
    Selection=0)
cluster = Cluster(property=uc, C=levels)
bhombuilding = Data(flatten(cluster))

speckleadapter_2 = BHoMObject(speckleadapter, m_ForcePreview=False, m_MaxItemsPreview=10000)
bhombuilding_2 = Data(flatten(bhombuilding))

# ----
# Push (upload) to Speckle
toggle = BooleanToggle(True)
push = Push(Adapter=speckleadapter_2, Objects=flatten(bhombuilding_2), Active=toggle, Component="{ .Push")  # -> Objects, Success

# ---- group: Temp workaround for 3drepo wrong axis
bhombuilding_3 = Data(flatten(bhombuilding))
yz = YZPlane(Origin=Point(0, 0, 0))
rotate = Rotate(Geometry=bhombuilding_3, Angle=-1.570796327, Plane=yz)  # -> Geometry, Transform
bhombuilding_4 = Data(flatten(rotate.Geometry))

# ----
# Push (upload) to 3D Repo
toggle_2 = BooleanToggle(True)
bhombuilding_5 = Data(flatten(bhombuilding_4))
_3drepoadapter = BHoMObject(repoadapter, m_ForcePreview=False, m_MaxItemsPreview=10000)
push_2 = Push(Adapter=_3drepoadapter, Objects=flatten(bhombuilding_5), Active=toggle_2, Component="{ .Push")  # -> Objects, Success

# ==== cluster Cluster
property = ClusterInput()
C = ClusterInput()
line = Line([Line((0, 0, 0), (0, 0, 3)), Line((0, 5, 0), (0, 5, 3)), Line((0, 10, 0), (0, 10, 3)), Line((0, 15, 0), (0, 15, 3)), Line((0, 20, 0), (0, 20, 3)), Line((5, 20, 0), (5, 20, 3)), Line((10, 20, 0), (10, 20, 3)), Line((10, 15, 0), (10, 15, 3)), Line((10, 10, 0), (10, 10, 3)), Line((10, 5, 0), (10, 5, 3)), Line((10, 0, 0), (10, 0, 3)), Line((5, 0, 0), (5, 0, 3))])
len = Length(Curve=line)
item = ListItem(List=len, Index=0, Wrap=True)
series = Series(Start=0, Step=item, Count=expr("x+1", C))
Z = UnitZ(Factor=series)
end = EndPoints(Curve=line)  # -> Start, End
Z_2 = UnitZ(Factor=Slider(0.4, range=0..1))
bar = Bar(
    Line=line,
    Property=property,
    OrientationAngle=0,
    FeaType="{ \"_t\" : \"System.Enum\", \"TypeName\" : { \"_t\" : \"System.Type\", \"Name\" : \"BH.oM.Structure.Elements.BarFEAType\" }, \"Value\" : \"Flexural\" }",
    Component="{ .Bar")
move = Move(Geometry=end.End, Motion=Z_2)  # -> Geometry, Transform
bbox = BoundingBox(Content=[end.End, move.Geometry], Plane=PlaneXY(0, 0, 0), UnionBox=True)  # -> Box, Box_2
smesh = SimpleMesh(Brep=bbox.Box)
extrude = Extrude(Bar=bar, Simple=True, Component="{ .Extrude")  # -> flatten(I)
data = Data([smesh, extrude])
move_2 = Move(Geometry=data, Motion=graft(Z))  # -> Geometry, Transform
G = ClusterOutput(move_2.Geometry)
