# Grasshopper definition multistoreyTest.gh (Grasshopper 1.0.7)
# plug-ins: BH.UI.Grasshopper

line = Line([Line((0, 0, 0), (0, 0, 3)), Line((0, 5, 0), (0, 5, 3)), Line((0, 10, 0), (0, 10, 3)), Line((0, 15, 0), (0, 15, 3)), Line((0, 20, 0), (0, 20, 3)), Line((5, 20, 0), (5, 20, 3)), Line((10, 20, 0), (10, 20, 3)), Line((10, 15, 0), (10, 15, 3)), Line((10, 10, 0), (10, 10, 3)), Line((10, 5, 0), (10, 5, 3)), Line((10, 0, 0), (10, 0, 3)), Line((5, 0, 0), (5, 0, 3))])
series = Series(Start=0, Step=Slider(3, range=0..10), Count=Slider(2, range=0..10))
level = Level(Elevation=series, Component="{ .Level")
line_2 = Line([Line((-5, 5, 0), (15, 5, 0)), Line((-5, 10, 0), (15, 10, 0)), Line((-5, 15, 0), (15, 15, 0)), Line((-5, 20, 0), (15, 20, 0)), Line((-5, 0, 0), (15, 0, 0)), Line((0, -5, 0), (0, 25, 0)), Line((5, -5, 0), (5, 25, 0)), Line((10, -5, 0), (10, 25, 0))])
pt = Point([<point referenced from the Rhino model> x15])
crv = Curve(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)
multistorey = MultiStorey(Levels=level, FloorOutlines=crv, ColumnPoints=pt, Component="{ .MultiStorey")
explode = Explode(Object=multistorey, Component="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")  # -> Levels, Grids, Floors, Walls, Columns, Beams, BHoM_Guid, Name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
